# Grasshopper definition parking (1).gh (Grasshopper 1.0.8)
# plug-ins: RhinoCodePluginGH

crv = Curve(<curve referenced from the Rhino model>)
explode = Explode(Curve=crv, Recursive=True)  # -> Segments, Vertices
cp = ControlPoints(Curve=explode.Segments)  # -> simplify(Points), Weights, Knots
item = ListItem(List=cp.Points, Index="1", Wrap=True)  # -> flatten(Item)
pt = Point([<point referenced from the Rhino model> x4])
ipy2 = IronPython2Script(points=pt, numRectangles=Slider(10, range=1..10))  # -> out, a; inputs points: list of Point3d, numRectangles: Int32
# ---------- ipy2: IronPython ----------
import Rhino.Geometry as rg
import rhinoscriptsyntax as rs
 
def interpolate(p1, p2, t):
    """ Interpolate between two points p1 and p2 by t (0 <= t <= 1). """
    return (p1[0] * (1 - t) + p2[0] * t, p1[1] * (1 - t) + p2[1] * t)
 
def intersectAtX(x1, y1, x2, y2, x):
    if x1 == x2:
        raise ValueError("x1 and x2 cannot be the same value.")
    # Calculate the slope
    slope = float(y2 - y1) / (x2 - x1)  # Ensure float division
    # Calculate y using the interpolation formula
    y = y1 + slope * (x - x1)
    return y
 
def interpolate2(x1, y1, x2, y2, x):
    """ Interpolate to find y at a given x between two points. """
    if x1 == x2:
        return None  # Avoid division by zero
    slope = float(y2 - y1) / (x2 - x1)  # Ensure float division
    y = y1 + slope * (x - x1)
    return y
 
def find_roof_and_floor(points, x):
    """ Given polygon points, find the roof and floor y values at the specified x. """
    roof = float('-inf')  # Start with the lowest possible value
    floor = float('inf')  # Start with the highest possible value
   
    # Number of points in the polygon
    n = len(points)
   
    # Check all edges of the polygon
    for i in range(n):
        p1 = points[i]
        p2 = points[(i + 1) % n]  # Wrap around to the first point
 
        # Check if the x coordinate of the point is within the x bounds of the edge
        if min(p1[0], p2[0]) <= x <= max(p1[0], p2[0]):
            # Perform interpolation to find the y value at the given x
            y_value = interpolate2(p1[0], p1[1], p2[0], p2[1], x)
            if y_value is not None:
                roof = max(roof, y_value)  # Update roof
                floor = min(floor, y_value)  # Update floor
 
    # Check if we found any valid roof and floor values
    if roof == float('-inf') or floor == float('inf'):
        raise ValueError("No valid y values found for the given x within the polygon.")
   
    return roof, floor
 
def is_point_inside_quadrilateral(point, quad):
    """ Check if a point is inside the given quadrilateral. """
    x, y = point
    x1, y1, z1 = quad[0]
    x2, y2, z2 = quad[1]
    x3, y3, z3 = quad[2]
    x4, y4, z4 = quad[3]
 
    def sign(p1, p2, p3):
        return (p1[0] - p3[0]) * (p2[1] - p3[1]) - (p2[0] - p3[0]) * (p1[1] - p3[1])
 
    b1 = sign(point, (x1, y1), (x2, y2)) < 0.0
    b2 = sign(point, (x2, y2), (x3, y3)) < 0.0
    b3 = sign(point, (x3, y3), (x4, y4)) < 0.0
    b4 = sign(point, (x4, y4), (x1, y1)) < 0.0
 
    return b1 == b2 == b3 == b4
 
def fit_three_rectangles(p1, p2, p3, p4):
    """ Fit three non-overlapping rectangles inside the quadrilateral defined by four points. """
    quad = [p1, p2, p3, p4]
   
    bl = quad[0]  # Bottom-left
    br = quad[1]  # Bottom-right
    tr = quad[2]  # Top-right
    tl = quad[3]  # Top-left
 
    # Prepare to collect rectangles
    rectangles = []
   
    # Calculate available height for rectangles
    available_height = min(tr[1], tl[1]) - bl[1]
   
    # Calculate actual total width of this shape
    mostLeft = float('inf')
    mostRight = float('-inf')
    for point in quad:
        if point[0] > mostRight: mostRight = point[0]
        if point[0] < mostLeft: mostLeft = point[0]
       
    total_width = mostRight - mostLeft
    rect_width = total_width / numRectangles
   
    for i in range(int(numRectangles)):
        x1 = mostLeft + i * rect_width
        x2 = mostLeft + (i + 1) * rect_width
       
        # Define rectangle's y-coordinates
        y1 = max(find_roof_and_floor(quad, x1)[1], find_roof_and_floor(quad, x2)[1])
        y2 = min(find_roof_and_floor(quad, x1)[0], find_roof_and_floor(quad, x2)[0])
       
        # Create rectangles and adjust y to fit
        rect = (x1, y1, x2 - x1, y2 - y1)  # (x, y, width, height)
 
        if (x2 - x1 >= 18 and y2 - y1 >= 45):
            rectangles.append(rect)
 
    return rectangles
 
def get_rectangle_corners(rect):
    """ Get the corners of a rectangle given its bottom-left corner and dimensions """
    x, y, width, height = rect
    return [
        (x, y),                   # Bottom-left
        (x, y + height),         # Top-left
        (x + width, y),          # Bottom-right
        (x + width, y + height)  # Top-right
    ]
 
# # Example usage
# pointList = []
# for point in points:
#     pointList.append((points[0], points[1], points[2]))
#     print(point)
print(points)
pointList = [rs.coerce3dpoint(x) for x in points]
 
rectangles = fit_three_rectangles(pointList[0], pointList[1], pointList[2], pointList[3])
rectangles_corners = [get_rectangle_corners(rect) for rect in rectangles]
rectangleCoords = []
 
# Print the corners of each rectangle and turn them into 3d points
for i, corners in enumerate(rectangles_corners):
    print "Rectangle {} Corners: {}".format(i + 1, corners)
    for corner in corners:
        rectangleCoords.append(rg.Point3d(corner[0], corner[1], 0))
 
a = rectangleCoords
# ---------- end ipy2 ----------
number_slider = Slider(9, range=1..30)
pt_2 = Point(item)
ipy2_2 = IronPython2Script(points=pt_2, offset_distance=Slider(100, range=1..100))  # -> out, a; inputs points: list of Point3d; disabled
# ---------- ipy2_2: IronPython ----------
import rhinoscriptsyntax as rs

def offset_rectangle_toward_center(points, offset_distance):
   # if len(points) != 4:
        #raise ValueError("Four points are required to define a rectangle.")#
    
    # Calculate the center of the rectangle
    center_x = sum(pt.X for pt in points) / 4.0
    center_y = sum(pt.Y for pt in points) / 4.0
    center_z = sum(pt.Z for pt in points) / 4.0
    center_point = rs.CreatePoint(center_x, center_y, center_z)
    
    offset_points = []
    
    for pt in points:
        # Calculate the direction vector toward the center
        direction_vector = center_point - pt
        direction_vector.Unitize()  # Normalize the direction
        
        # Create the new point by offsetting toward the center
        new_point = pt + direction_vector * offset_distance
        offset_points.append(new_point)
    
    return offset_points

# Example input
input_points = [rs.coerce3dpoint(x) for x in points]  # Assume `points` is your input list
offset_distance = offset_distance  # Hardcoded distance
result_points = offset_rectangle_toward_center(input_points, offset_distance)

# Output the new points
a = result_points
# ---------- end ipy2_2 ----------
panel = Panel("""0
1
3
2""")
ipy2_3 = IronPython2Script(points=pt_2, distance=Slider(18, range=1..20), step=number_slider)  # -> out, a, b; inputs points: list of Point3d, distance: Int32, step: Int32
# ---------- ipy2_3: IronPython ----------
import Rhino.Geometry as rg

def lines_to_nearest_border(points, distance, step):
    if len(points) < 3:
        return None, 0  # Return 0 if not enough points to form a closed polygon

    # Create a polyline from the base shape (points)
    polyline = rg.Polyline(points)
    
    # Ensure the polyline is closed
    if not polyline.IsClosed:
        polyline.Add(polyline[0])
    
    # Create the closed curve from the polyline
    poly_curve = polyline.ToNurbsCurve()

    # Offset the base polyline by the specified distance
    offset_curves = poly_curve.Offset(rg.Plane.WorldXY, -distance, 0.01, rg.CurveOffsetCornerStyle.Sharp)
    
    if offset_curves is None or len(offset_curves) == 0:
        return None, 0  # Return 0 if the offset failed

    # Use the first offset curve (assuming one is generated)
    offset_curve = offset_curves[0]

    # Divide the offset curve into points every 'step' feet
    divide_params = offset_curve.DivideByLength(step, True)  # True to include the last point

    if not divide_params:
        return None, 0  # Return 0 if division failed

    # List to store the lines connecting points on the offset curve to the base shape
    connecting_lines = []
    
    # Create lines from each divided point on the offset curve to the nearest point on the base curve
    for param in divide_params:
        # Get the divided point on the offset curve
        offset_point = offset_curve.PointAt(param)
        
        # Find the closest point on the original base shape (poly_curve)
        closest_param = poly_curve.ClosestPoint(offset_point)[1]
        closest_point = poly_curve.PointAt(closest_param)
        
        # Create a line from the point on the offset curve to the closest point on the base shape
        line = rg.Line(offset_point, closest_point)
        connecting_lines.append(line)
    
    # Return the list of lines and the number of parking spots (i.e., the number of lines)
    return connecting_lines, len(connecting_lines)

# Example usage in Grasshopper:
# Points, distance (offset), and step (distance between lines) are input parameters in Grasshopper
generated_lines, num_parking_spots = lines_to_nearest_border(points, distance, step)

# Output the lines to Grasshopper for visualization
a = [line.ToNurbsCurve() for line in generated_lines]  # Output the lines as NURBS curves for visualization
b = num_parking_spots  # Output the number of parking spots created
# ---------- end ipy2_3 ----------
ipy2_4 = IronPython2Script(
    points=pt_2,
    long_spacing=Slider(18, range=5..30),
    threshold=Slider(41, range=0..100),
    short_spacing=Slider(63, range=0..100))  # -> out, a; inputs points: list of Point3d, long_spacing: Int32, threshold: Int32, short_spacing: Int32
# ---------- ipy2_4: IronPython ----------
import rhinoscriptsyntax as rs

def create_grid_of_points(points, short_spacing, long_spacing):
    lengths = [
        rs.Distance(points[0], points[1]),
        rs.Distance(points[1], points[2]),
        rs.Distance(points[2], points[3]),
        rs.Distance(points[3], points[0]),
    ]
    
    short_length = min(lengths)
    long_length = max(lengths)
    
    num_short_points = int(short_length // short_spacing)
    num_long_points = int(long_length // long_spacing)
    
    grid_points = []


    exclusion_indices = [(i, 1) for i in range(1, num_short_points)] + [(i, num_long_points - 1) for i in range(1, num_short_points)] + [( num_short_points ,1)] + [(0, num_long_points - 1)]  

    for i in range(num_short_points + 1):  
        short_side_point = points[0] + (points[1] - points[0]) * (i / num_short_points)
        for j in range(num_long_points + 1):  
            long_side_point = points[0] + (points[3] - points[0]) * (j / num_long_points)
            new_point = short_side_point + (long_side_point - points[0])
            
            if (i, j) not in exclusion_indices:
                grid_points.append(new_point)

    return grid_points

input_points = [rs.coerce3dpoint(x) for x in points]

result_grid = create_grid_of_points(input_points, short_spacing, long_spacing)

a = result_grid
# ---------- end ipy2_4 ----------
partition = PartitionList(List=ipy2.a, Size=4)
pt_3 = Point(ipy2_2.a)
number_of_parkings_required = Panel("2500")
panel_2 = Panel(ipy2_2.a)
item_2 = ListItem(List=partition, Index=panel, Wrap=True)
ipy2_5 = IronPython2Script(points=pt_2, distance=Slider(63, range=1..100), step=number_slider, line_length=Slider(20, range=1..100))  # -> out, a, b; inputs points: list of Point3d, distance: Int32, step: Int32, line_length: Int32
# ---------- ipy2_5: IronPython ----------
import Rhino.Geometry as rg

def lines_with_fixed_length(points, distance, step, line_length):
    if len(points) < 3:
        return None, 0  # Return 0 if not enough points to form a closed polygon

    # Create a polyline from the base shape (points)
    polyline = rg.Polyline(points)
    
    # Ensure the polyline is closed
    if not polyline.IsClosed:
        polyline.Add(polyline[0])
    
    # Create the closed curve from the polyline
    poly_curve = polyline.ToNurbsCurve()

    # Offset the base polyline by the specified distance
    offset_curves = poly_curve.Offset(rg.Plane.WorldXY, -distance, 0.01, rg.CurveOffsetCornerStyle.Sharp)
    
    if offset_curves is None or len(offset_curves) == 0:
        return None, 0  # Return 0 if the offset failed

    # Use the first offset curve (assuming one is generated)
    offset_curve = offset_curves[0]

    # Divide the offset curve into points every 'step' feet
    divide_params = offset_curve.DivideByLength(step, True)  # True to include the last point

    if not divide_params:
        return None, 0  # Return 0 if division failed

    # List to store the lines connecting points on the offset curve to the base shape
    connecting_lines = []
    
    # Create lines from each divided point on the offset curve with a fixed length
    for param in divide_params:
        # Get the divided point on the offset curve
        offset_point = offset_curve.PointAt(param)
        
        # Find the closest point on the original base shape (poly_curve)
        closest_param = poly_curve.ClosestPoint(offset_point)[1]
        closest_point = poly_curve.PointAt(closest_param)
        
        # Create a vector from the offset point to the closest point on the base shape
        vector = closest_point - offset_point
        vector.Unitize()  # Normalize the vector
        
        # Scale the vector by the specified line length
        scaled_vector = vector * line_length
        
        # Create the line from the offset point in the direction of the closest point, with fixed length
        end_point = offset_point + scaled_vector
        line = rg.Line(offset_point, end_point)
        
        connecting_lines.append(line)
    
    # Return the list of lines and the number of parking spots (i.e., the number of lines)
    return connecting_lines, len(connecting_lines)

# Example usage in Grasshopper:
# Points, distance (offset), step (distance between lines), and line_length are input parameters in Grasshopper
generated_lines, num_parking_spots = lines_with_fixed_length(points, distance, step, line_length)

# Output the lines to Grasshopper for visualization
a = [line.ToNurbsCurve() for line in generated_lines]  # Output the lines as NURBS curves for visualization
b = num_parking_spots  # Output the number of parking spots created
# ---------- end ipy2_5 ----------
ipy2_6 = IronPython2Script(points=ipy2.a, x_space=Slider(23, range=0..100))  # -> out, a; inputs points: list of Point3d, x_space: Int32; disabled
# ---------- ipy2_6: IronPython ----------
import Rhino.Geometry as rg
import math

def sort_points_counterclockwise(points):
    """
    Sort points in counterclockwise order around their centroid.
    
    Parameters:
        points (list): A list of 3D points to be sorted.
    
    Returns:
        list: A sorted list of points in counterclockwise order.
    """
    # Calculate the centroid (average of the points)
    centroid = rg.Point3d(
        sum(p.X for p in points) / len(points),
        sum(p.Y for p in points) / len(points),
        sum(p.Z for p in points) / len(points)
    )
    
    # Function to calculate the angle between a point and the centroid
    def angle_from_centroid(point):
        return math.atan2(point.Y - centroid.Y, point.X - centroid.X)

    # Sort points by angle (counterclockwise)
    sorted_points = sorted(points, key=angle_from_centroid)
    
    return sorted_points

def generate_polygon_outline(points):
    """
    Generate the outline of a polygon based on provided points.
    
    Parameters:
        points (list): A list of 3D points that form the vertices of the polygon.
    
    Returns:
        PolylineCurve: A closed curve representing the polygon outline.
    """
    if len(points) < 3:
        return None  # A polygon needs at least 3 points
    
    # Sort the points in counterclockwise order
    sorted_points = sort_points_counterclockwise(points)
    
    # Create a polyline from the sorted points
    polyline = rg.Polyline(sorted_points)
    
    # Ensure the polyline is closed
    if not polyline.IsClosed:
        polyline.Add(polyline[0])  # Add the first point to close the polyline
    
    # Convert the polyline to a PolylineCurve to use in Grasshopper
    polyline_curve = rg.PolylineCurve(polyline)
    
    return polyline_curve

def create_points_on_outline(polygon_curve, spacing):
    """
    Create points along the polygon outline at specified spacing.
    
    Parameters:
        polygon_curve (PolylineCurve): The closed curve representing the polygon outline.
        spacing (float): The distance between points along the polygon outline.
    
    Returns:
        list: A list of points along the polygon outline, spaced by the specified distance.
    """
    # Divide the polyline curve by the given length (spacing)
    divide_params = polygon_curve.DivideByLength(spacing, True)  # True to include the last point
    
    if not divide_params:
        return []  # Return an empty list if division fails
    
    # Get the points from the division parameters
    outline_points = [polygon_curve.PointAt(param) for param in divide_params]
    
    return outline_points

# Generate the polygon outline from the input points
polygon_outline = generate_polygon_outline(points)

# Ensure the polygon_outline is valid before creating points
if polygon_outline:
    # Create the points along the polygon outline based on the provided spacing (x_space for spacing)
    outline_points = create_points_on_outline(polygon_outline, x_space)

    # Output the points along the outline
    a = outline_points  # 'a' is the output of the Grasshopper Python component
else:
    a = []  # Return an empty list if the outline creation fails
# ---------- end ipy2_6 ----------
ipy2_7 = IronPython2Script(points=ipy2.a, long_spacing=Slider(20, range=5..30), short_spacing=Slider(34, range=0..100))  # -> out, a; inputs points: list of Point3d, long_spacing: Int32, short_spacing: Int32; disabled
# ---------- ipy2_7: IronPython ----------
import rhinoscriptsyntax as rs
import math

def find_roof_and_floor(point, polygon):
    """
    Find the roof and floor y-values for a given point inside a polygon. The roof is the topmost y-value,
    and the floor is the bottommost y-value along the vertical line through the given point.

    Parameters:
        point (Point3d): The point for which to find the roof and floor.
        polygon (list): A list of 3D points representing the vertices of the polygon.

    Returns:
        tuple: A tuple (roof, floor) representing the highest and lowest y-values along the vertical line through the point.
    """
    if len(polygon) < 3:
        return None  # A polygon needs at least 3 points
    
    # Extract the X-coordinate of the point
    x = point.X
    
    # Initialize roof and floor to extreme values
    roof = float('-inf')
    floor = float('inf')
    
    # Loop through each edge of the polygon (pair of consecutive points)
    for i in range(len(polygon)):
        p1 = polygon[i]
        p2 = polygon[(i + 1) % len(polygon)]  # Wrap around to the first point for the last edge
        
        # Check if the vertical line through 'point' (constant x) intersects the edge (p1, p2)
        if min(p1.X, p2.X) <= x <= max(p1.X, p2.X):  # Check if x is between the x-values of p1 and p2
            
            if p1.X == p2.X:
                # If the edge is vertical (same X values), we directly consider Y values
                roof = max(roof, p1.Y, p2.Y)
                floor = min(floor, p1.Y, p2.Y)
            else:
                # Calculate the y-value of the intersection using linear interpolation
                slope = (p2.Y - p1.Y) / (p2.X - p1.X)
                y_intersection = p1.Y + slope * (x - p1.X)
                
                # Update roof and floor based on the intersection point
                roof = max(roof, y_intersection)
                floor = min(floor, y_intersection)
    
    return roof, floor

def sort_points_counterclockwise(points):
    """
    Sort points in counterclockwise order around their centroid.
    
    Parameters:
        points (list): A list of 3D points to be sorted.
    
    Returns:
        list: A sorted list of points in counterclockwise order.
    """
    # Calculate the centroid (average of the points)
    centroid_x = sum(p.X for p in points) / len(points)
    centroid_y = sum(p.Y for p in points) / len(points)
    centroid = rs.CreatePoint(centroid_x, centroid_y, 0)
    
    # Function to calculate the angle between a point and the centroid
    def angle_from_centroid(point):
        return math.atan2(point.Y - centroid.Y, point.X - centroid.X)

    # Sort points by angle (counterclockwise)
    sorted_points = sorted(points, key=angle_from_centroid)
    
    return sorted_points

def create_grid_of_points(points, short_spacing, long_spacing):
    """
    Create a grid of points based on the bounding box of the input points, with the specified spacing.
    Points that fall outside the polygon's roof and floor are excluded.
    """
    # Sort the points in counterclockwise order
    sorted_points = sort_points_counterclockwise(points)

    # Calculate the bounding box of the sorted points
    bounding_box = rs.BoundingBox(sorted_points)

    # Extract the corners of the bounding box
    pt0 = bounding_box[0]  # Bottom-left corner
    pt1 = bounding_box[1]  # Bottom-right corner
    pt2 = bounding_box[3]  # Top-left corner
    pt3 = bounding_box[2]  # Top-right corner

    # Calculate lengths of the sides of the bounding box
    horizontal_length = rs.Distance(pt0, pt1)  
    vertical_length = rs.Distance(pt1, pt3)    # Length of the right (vertical) side

    if horizontal_length > vertical_length:
        long_length = horizontal_length
        short_length = vertical_length
        num_long_points = int(long_length // short_spacing)  # Apply short_spacing to the longest side (horizontal)
        num_short_points = int(short_length // long_spacing)  # Apply long_spacing to the shortest side (vertical)
    else:
        long_length = vertical_length
        short_length = horizontal_length
        num_long_points = int(long_length // short_spacing)  # Apply short_spacing to the longest side (vertical)
        num_short_points = int(short_length // long_spacing)  # Apply long_spacing to the shortest side (horizontal)

    grid_points = []

    for i in range(num_short_points + 1):
        short_side_point = pt0 + (pt1 - pt0) * (i / float(num_short_points))  # Points along the short side
        for j in range(num_long_points + 1):
            long_side_point = pt0 + (pt2 - pt0) * (j / float(num_long_points))  # Points along the long side
            new_point = short_side_point + (long_side_point - pt0)

            roof, floor = find_roof_and_floor(new_point, sorted_points)
            
            if floor <= new_point.Y <= roof:
                grid_points.append(new_point)

    return grid_points


input_points = [rs.coerce3dpoint(x) for x in points] 


result_grid = create_grid_of_points(input_points, short_spacing, long_spacing)


a = result_grid
# ---------- end ipy2_7 ----------
pline = PolyLine(Vertices=item_2, Closed=True)
addition = Addition(A=ipy2_3.b, B=ipy2_5.b)
panel_3 = Panel(addition)
offset = OffsetCurve(Curve=pline, Distance=1, Corners=1)
bbox = BoundingBox(Content=flatten(pline), Plane=PlaneXY(0, 0, 0), UnionBox=True)  # -> Box, Box_2
pt_4 = Point(ipy2_4.a)
box_corners = BoxCorners(Box=bbox.Box)  # -> CornerA, CornerB, CornerC, CornerD, CornerE, CornerF, CornerG, CornerH
runion = RegionUnion(Curves=flatten(offset))
dist = Distance(PointA=box_corners.CornerA, PointB=box_corners.CornerB)
dist_2 = Distance(PointA=box_corners.CornerA, PointB=box_corners.CornerD)
boundary = BoundarySurfaces(Edges=runion)
number_slider_2 = Slider(18, range=1..30)
number_slider_3 = Slider(15, range=1..100)
pt_5 = Point(box_corners.CornerA)
division = Division(A=dist, B=number_slider_2)
division_2 = Division(A=dist_2, B=number_slider_3)
round = Round(Number=division)  # -> Nearest, Floor, Ceiling
round_2 = Round(Number=division_2)  # -> Nearest, Floor, Ceiling
recgrid = Rectangular(Plane=pt_5, SizeX=number_slider_2, SizeY=number_slider_3, ExtentX=round.Ceiling, ExtentY=round_2.Ceiling)  # -> Cells, Points
number_slider_4 = Slider(2, range=0..5)
number_slider_5 = Slider(2, range=0..5)
project = Project(Curve=recgrid.Cells, Brep=boundary, Direction=Vector(0, 0, 1))
dom = Domain(DomainStart=expr("-x/2", number_slider_4), DomainEnd=expr("x/2", number_slider_4))
dom_2 = Domain(DomainStart=expr("-x/2", number_slider_5), DomainEnd=expr("x/2", number_slider_5))
cls = Closed(Curve=project)  # -> Closed, Periodic
rectangle = Rectangle(Plane=PlaneXY(0, 0, 0), XSize=dom, YSize=dom_2, Radius=0)  # -> Rectangle, Length
pt_6 = Point(pt_4)
dispatch = Dispatch(List=project, DispatchPattern=cls.Closed)  # -> ListA, ListB
division_3 = Division(A=number_slider_4, B="2")
division_4 = Division(A=number_of_parkings_required, B=panel_3)
rec = Rectangle(rectangle.Rectangle)
move = Move(Geometry=pt_6, Motion="0,0,0.5")  # -> Geometry, Transform
crv_2 = Curve(simplify(dispatch.ListA))
offset_2 = OffsetCurve(Curve=crv, Distance=division_3, Corners=1)
expression = Expression(x=division_4, Expression="Round(x)")
pshift = ShiftPaths(Data=crv_2, Offset=-1)
move_2 = Move(Geometry=rec, Motion=move.Geometry)  # -> Geometry, Transform
explode_2 = Explode(Curve=pshift, Recursive=True)  # -> Segments, Vertices
ln = Line(StartPoint="0,0,0", EndPoint="0,0,11")
item_3 = ListItem(List=explode_2.Segments, Index=0, Wrap=True)  # -> flatten(Item)
item_4 = ListItem(List=explode_2.Segments, Index=2, Wrap=True)  # -> flatten(Item)
Z = UnitZ(Factor="11")
extr = Extrude(Base=move_2.Geometry, Direction=Z)
Z_2 = UnitZ(Factor="0.5")
extr_2 = Extrude(Base=offset_2, Direction=Z_2)
cp_2 = ControlPoints(Curve=offset_2)  # -> Points, Weights, Knots
join = JoinCurves(Curves=item_4, Preserve=False)
join_2 = JoinCurves(Curves=item_3, Preserve=False)
cap = CapHoles(Brep=extr)
cap_2 = CapHoles(Brep=extr_2)
item_5 = ListItem(List=join, Index=-1, Wrap=True)
item_6 = ListItem(List=cp_2.Points, Index="0", Wrap=True)
mesh = MeshBrep(
    Brep=cap,
    Settings={GridMaxCount=0, GridMinCount=16, JaggedSeams=False, MaxEdgeLength=0, MinEdgeLength=0.0001, MinTolerance=0, Refine=True, RefineAngle=0, RelativeTolerance=0.65, SimplePlanes=True, Tolerance=0})
mesh_2 = MeshBrep(
    Brep=cap_2,
    Settings={GridMaxCount=0, GridMinCount=16, JaggedSeams=False, MaxEdgeLength=0, MinEdgeLength=0.0001, MinTolerance=0, Refine=True, RefineAngle=0, RelativeTolerance=0.65, SimplePlanes=True, Tolerance=0})
merge = Merge(Data1=join_2, Data2=item_5)
pt_7 = Point(item_6)
mesh_3 = Mesh(graft(mesh))
mesh_4 = Mesh(mesh_2)
cp_3 = ControlPoints(Curve=merge)  # -> Points, Weights, Knots
Z_3 = UnitZ(Factor="11.5")
addition_2 = Addition(A=expression, B="1")
Z_4 = UnitZ(Factor="11.5")
arrlinear = LinearArray(Geometry=pt_7, Direction=Z_4, Count=expression)  # -> simplify(Geometry), Transform
arrlinear_2 = LinearArray(Geometry=pt_7, Direction=Z_3, Count=addition_2)  # -> simplify(Geometry), Transform
move_3 = Move(Geometry=mesh_3, Motion=arrlinear.Geometry)  # -> Geometry, Transform
py3 = Python3Script(n_floors=mesh_4)  # -> out, a
# ---------- py3: Python ----------
FC = 5000 #psi

def size_column(Pu, area, fc, factor = 0.45):
    area = Pu/(factor*fc)
    side = round(area**0.5,0)
    return side

def get_trib_load(n_floors, trib_len, trib_width, SDLpsf = 10, LLpsf = 40, slab_thickness = 12):
    # assumes slab thickness in inches
    trib_area = trib_len*trib_width #FT2
    dl = C_DENSITY_PCF*(slab_thickness/12)*trib_area # lb units
    sdl = SDLpsf*trib_area # lb units
    ll = LLpsf*trib_area #lb units
    t_dl = n_floors*(dl+sdl)
    t_ll = n_floors*ll
    Pu_lrfd = 1.2*t_dl + 1.6*t_ll
    return Pu_lrfd, trib_area


Pu, area = get_trib_load(n_floors, trib_len, trib_width)
column_side_length = size_column(Pu, area, FC)
a = column_side_length
# ---------- end py3 ----------
move_4 = Move(Geometry=mesh_4, Motion=arrlinear_2.Geometry)  # -> Geometry, Transform
mesh_5 = Mesh(move_3.Geometry)
mesh_6 = Mesh(move_4.Geometry)
panel_4 = Panel(py3.out)
