# Grasshopper definition parking.gh (Grasshopper 1.0.8)
# plug-ins: RhinoCodePluginGH

crv = Curve()
explode = Explode(Curve=crv, Recursive=True)  # -> Segments, Vertices
cp = ControlPoints(Curve=explode.Segments)  # -> simplify(Points), Weights, Knots
minwidth = Integer(18)
minheight = Integer(45)
pt = Point([Point(25.08378736, 29.33618289, 0), Point(147.6469012, 34.73543901, 0), Point(144.9472732, 114.6444296, 0), Point(39.12185326, 114.6444296, 0)])
item = ListItem(List=cp.Points, Index="1", Wrap=True)  # -> flatten(Item)
ipy2 = IronPython2Script(points=pt, numRectangles=Slider(5, range=1..100), minWidth=minwidth, minHeight=minheight)  # -> out, a; inputs points: list of Point3d, numRectangles: Int32
# ---------- ipy2: IronPython ----------
import Rhino.Geometry as rg
import rhinoscriptsyntax as rs
 
def interpolate(p1, p2, t):
    """ Interpolate between two points p1 and p2 by t (0 <= t <= 1). """
    return (p1[0] * (1 - t) + p2[0] * t, p1[1] * (1 - t) + p2[1] * t)
 
def intersectAtX(x1, y1, x2, y2, x):
    if x1 == x2:
        raise ValueError("x1 and x2 cannot be the same value.")
    # Calculate the slope
    slope = float(y2 - y1) / (x2 - x1)  # Ensure float division
    # Calculate y using the interpolation formula
    y = y1 + slope * (x - x1)
    return y
 
def interpolate2(x1, y1, x2, y2, x):
    """ Interpolate to find y at a given x between two points. """
    if x1 == x2:
        return None  # Avoid division by zero
    slope = float(y2 - y1) / (x2 - x1)  # Ensure float division
    y = y1 + slope * (x - x1)
    return y
 
def find_roof_and_floor(points, x):
    """ Given polygon points, find the roof and floor y values at the specified x. """
    roof = float('-inf')  # Start with the lowest possible value
    floor = float('inf')  # Start with the highest possible value
   
    # Number of points in the polygon
    n = len(points)
   
    # Check all edges of the polygon
    for i in range(n):
        p1 = points[i]
        p2 = points[(i + 1) % n]  # Wrap around to the first point
 
        # Check if the x coordinate of the point is within the x bounds of the edge
        if min(p1[0], p2[0]) <= x <= max(p1[0], p2[0]):
            # Perform interpolation to find the y value at the given x
            y_value = interpolate2(p1[0], p1[1], p2[0], p2[1], x)
            if y_value is not None:
                roof = max(roof, y_value)  # Update roof
                floor = min(floor, y_value)  # Update floor
 
    # Check if we found any valid roof and floor values
    if roof == float('-inf') or floor == float('inf'):
        raise ValueError("No valid y values found for the given x within the polygon.")
   
    return roof, floor
 
def is_point_inside_quadrilateral(point, quad):
    """ Check if a point is inside the given quadrilateral. """
    x, y = point
    x1, y1, z1 = quad[0]
    x2, y2, z2 = quad[1]
    x3, y3, z3 = quad[2]
    x4, y4, z4 = quad[3]
 
    def sign(p1, p2, p3):
        return (p1[0] - p3[0]) * (p2[1] - p3[1]) - (p2[0] - p3[0]) * (p1[1] - p3[1])
 
    b1 = sign(point, (x1, y1), (x2, y2)) < 0.0
    b2 = sign(point, (x2, y2), (x3, y3)) < 0.0
    b3 = sign(point, (x3, y3), (x4, y4)) < 0.0
    b4 = sign(point, (x4, y4), (x1, y1)) < 0.0
 
    return b1 == b2 == b3 == b4
 
def fit_three_rectangles(p1, p2, p3, p4):
    """ Fit three non-overlapping rectangles inside the quadrilateral defined by four points. """
    quad = [p1, p2, p3, p4]
   
    bl = quad[0]  # Bottom-left
    br = quad[1]  # Bottom-right
    tr = quad[2]  # Top-right
    tl = quad[3]  # Top-left
 
    # Prepare to collect rectangles
    rectangles = []
   
    # Calculate available height for rectangles
    available_height = min(tr[1], tl[1]) - bl[1]
   
    # Calculate actual total width of this shape
    mostLeft = float('inf')
    mostRight = float('-inf')
    for point in quad:
        if point[0] > mostRight: mostRight = point[0]
        if point[0] < mostLeft: mostLeft = point[0]
       
    total_width = mostRight - mostLeft
    rect_width = total_width / numRectangles
   
    for i in range(int(numRectangles)):
        x1 = mostLeft + i * rect_width
        x2 = mostLeft + (i + 1) * rect_width
       
        # Define rectangle's y-coordinates
        y1 = max(find_roof_and_floor(quad, x1)[1], find_roof_and_floor(quad, x2)[1])
        y2 = min(find_roof_and_floor(quad, x1)[0], find_roof_and_floor(quad, x2)[0])
       
        # Create rectangles and adjust y to fit
        rect = (x1, y1, x2 - x1, y2 - y1)  # (x, y, width, height)
 
        if (x2 - x1 >= 18 and y2 - y1 >= 45):
            rectangles.append(rect)
 
    return rectangles
 
def get_rectangle_corners(rect):
    """ Get the corners of a rectangle given its bottom-left corner and dimensions """
    x, y, width, height = rect
    return [
        (x, y),                   # Bottom-left
        (x, y + height),         # Top-left
        (x + width, y),          # Bottom-right
        (x + width, y + height)  # Top-right
    ]
 
# # Example usage
# pointList = []
# for point in points:
#     pointList.append((points[0], points[1], points[2]))
#     print(point)
print(points)
pointList = [rs.coerce3dpoint(x) for x in points]
 
rectangles = fit_three_rectangles(pointList[0], pointList[1], pointList[2], pointList[3])
rectangles_corners = [get_rectangle_corners(rect) for rect in rectangles]
rectangleCoords = []
 
# Print the corners of each rectangle and turn them into 3d points
for i, corners in enumerate(rectangles_corners):
    print "Rectangle {} Corners: {}".format(i + 1, corners)
    for corner in corners:
        rectangleCoords.append(rg.Point3d(corner[0], corner[1], 0))
 
a = rectangleCoords
# ---------- end ipy2 ----------
pt_2 = Point(item)
ipy2_2 = IronPython2Script(points=pt_2, offset_distance=Slider(100, range=1..100))  # -> out, a; inputs points: list of Point3d; disabled
# ---------- ipy2_2: IronPython ----------
import rhinoscriptsyntax as rs

def offset_rectangle_toward_center(points, offset_distance):
   # if len(points) != 4:
        #raise ValueError("Four points are required to define a rectangle.")#
    
    # Calculate the center of the rectangle
    center_x = sum(pt.X for pt in points) / 4.0
    center_y = sum(pt.Y for pt in points) / 4.0
    center_z = sum(pt.Z for pt in points) / 4.0
    center_point = rs.CreatePoint(center_x, center_y, center_z)
    
    offset_points = []
    
    for pt in points:
        # Calculate the direction vector toward the center
        direction_vector = center_point - pt
        direction_vector.Unitize()  # Normalize the direction
        
        # Create the new point by offsetting toward the center
        new_point = pt + direction_vector * offset_distance
        offset_points.append(new_point)
    
    return offset_points

# Example input
input_points = [rs.coerce3dpoint(x) for x in points]  # Assume `points` is your input list
offset_distance = offset_distance  # Hardcoded distance
result_points = offset_rectangle_toward_center(input_points, offset_distance)

# Output the new points
a = result_points
# ---------- end ipy2_2 ----------
ipy2_3 = IronPython2Script(points=pt_2, distance=Slider(9, range=1..20))  # -> out, a; inputs points: list of Point3d, distance: Int32; disabled
# ---------- ipy2_3: IronPython ----------
import Rhino.Geometry as rg

def parallel_lines_from_points(points, distance):
    """
    Create parallel lines at a specified distance from a closed polyline formed by a list of points,
    and return the offset curves as polylines.

    Parameters:
        points (list): A list of 3D points that form the vertices of the shape.
        distance (float): The distance away from the shape to create the parallel lines (negative for inside offset).
    
    Returns:
        list: A list of polylines for the newly created parallel lines.
    """
    if len(points) < 3:
        return None  # A shape needs at least 3 points to form a closed polygon
    
    # Create a polyline from the points
    polyline = rg.Polyline(points)
    
    # Ensure the polyline is closed
    if not polyline.IsClosed:
        polyline.Add(polyline[0])  # Add the first point to close the polyline
    
    # Create the closed curve from the polyline
    poly_curve = polyline.ToNurbsCurve()

    # Offset the curve inside the shape (negative distance for inside offset)
    offset_curves = poly_curve.Offset(rg.Plane.WorldXY, -distance, 0.01, rg.CurveOffsetCornerStyle.Sharp)
    
    if offset_curves is None or len(offset_curves) == 0:
        return None  # Return None if the offset fails or does not generate any curves

    # Convert offset curves to polylines
    polylines = []
    for curve in offset_curves:
        polyline_curve = curve.ToPolyline(0, 0, 0, 0, 0, 0, True)  # Convert to polyline
        polylines.append(polyline_curve)
    
    return polylines

# Example usage in Grasshopper:
# Points and distance are input parameters in Grasshopper
offset_polylines = parallel_lines_from_points(points, distance)

# Output the offset polylines to Grasshopper
a = offset_polylines  # 'a' is the output of the Grasshopper Python component
# ---------- end ipy2_3 ----------
ipy2_4 = IronPython2Script(
    points=pt_2,
    long_spacing=Slider(18, range=5..30),
    threshold=Slider(41, range=0..100),
    short_spacing=Slider(27, range=0..100))  # -> out, a; inputs points: list of Point3d, long_spacing: Int32, threshold: Int32, short_spacing: Int32; disabled
# ---------- ipy2_4: IronPython ----------
import rhinoscriptsyntax as rs

def create_grid_of_points(points, short_spacing, long_spacing):
    lengths = [
        rs.Distance(points[0], points[1]),
        rs.Distance(points[1], points[2]),
        rs.Distance(points[2], points[3]),
        rs.Distance(points[3], points[0]),
    ]
    
    short_length = min(lengths)
    long_length = max(lengths)
    
    num_short_points = int(short_length // short_spacing)
    num_long_points = int(long_length // long_spacing)
    
    grid_points = []


    exclusion_indices = [(i, 1) for i in range(1, num_short_points)] + [(i, num_long_points - 1) for i in range(1, num_short_points)] + [( num_short_points ,1)] + [(0, num_long_points - 1)]  

    for i in range(num_short_points + 1):  
        short_side_point = points[0] + (points[1] - points[0]) * (i / num_short_points)
        for j in range(num_long_points + 1):  
            long_side_point = points[0] + (points[3] - points[0]) * (j / num_long_points)
            new_point = short_side_point + (long_side_point - points[0])
            
            if (i, j) not in exclusion_indices:
                grid_points.append(new_point)

    return grid_points

input_points = [rs.coerce3dpoint(x) for x in points]

result_grid = create_grid_of_points(input_points, short_spacing, long_spacing)

a = result_grid
# ---------- end ipy2_4 ----------
pt_3 = Point(ipy2_2.a)
ipy2_5 = IronPython2Script(points=ipy2.a)  # -> out, a; inputs points: list of Point3d; disabled
# ---------- ipy2_5: IronPython ----------
import Rhino.Geometry as rg
import math

def sort_points_counterclockwise(points):
    """
    Sort points in counterclockwise order around their centroid.
    
    Parameters:
        points (list): A list of 3D points to be sorted.
    
    Returns:
        list: A sorted list of points in counterclockwise order.
    """
    # Calculate the centroid (average of the points)
    centroid = rg.Point3d(
        sum(p.X for p in points) / len(points),
        sum(p.Y for p in points) / len(points),
        sum(p.Z for p in points) / len(points)
    )
    
    # Function to calculate the angle between a point and the centroid
    def angle_from_centroid(point):
        return math.atan2(point.Y - centroid.Y, point.X - centroid.X)

    # Sort points by angle (counterclockwise)
    sorted_points = sorted(points, key=angle_from_centroid)
    
    return sorted_points

def generate_polygon_outline(points):
    """
    Generate the outline of a polygon based on provided points.
    
    Parameters:
        points (list): A list of 3D points that form the vertices of the polygon.
    
    Returns:
        PolylineCurve: A closed curve representing the polygon outline.
    """
    if len(points) < 3:
        return None  # A polygon needs at least 3 points
    
    # Sort the points in counterclockwise order
    sorted_points = sort_points_counterclockwise(points)
    
    # Create a polyline from the sorted points
    polyline = rg.Polyline(sorted_points)
    
    # Ensure the polyline is closed
    if not polyline.IsClosed:
        polyline.Add(polyline[0])  # Add the first point to close the polyline
    
    # Convert the polyline to a PolylineCurve to use in Grasshopper
    polyline_curve = rg.PolylineCurve(polyline)
    
    return polyline_curve

# Example input points (from Grasshopper input)
polygon_outline = generate_polygon_outline(points)

# Output the polyline curve as the polygon outline
a = polygon_outline  # 'a' is the output of the Grasshopper Python component
# ---------- end ipy2_5 ----------
panel = Panel(ipy2_2.a)
ipy2_6 = IronPython2Script(polyline=ipy2_3.a, step=Slider(8, range=1..30))  # -> out, a; inputs polyline: Polyline, distance: Int32, step: Int32; disabled
# ---------- ipy2_6: IronPython ----------
import Rhino.Geometry as rg

def parallel_lines_from_points(points, distance):
    """
    Create parallel lines at a specified distance from a closed polyline formed by a list of points,
    and return the offset curves as polylines.

    Parameters:
        points (list): A list of 3D points that form the vertices of the shape.
        distance (float): The distance away from the shape to create the parallel lines (negative for inside offset).
    
    Returns:
        list: A list of polylines for the newly created parallel lines.
    """
    if len(points) < 3:
        return None  # A shape needs at least 3 points to form a closed polygon
    
    # Create a polyline from the points
    polyline = rg.Polyline(points)
    
    # Ensure the polyline is closed
    if not polyline.IsClosed:
        polyline.Add(polyline[0])  # Add the first point to close the polyline
    
    # Create the closed curve from the polyline
    poly_curve = polyline.ToNurbsCurve()

    # Offset the curve inside the shape (negative distance for inside offset)
    offset_curves = poly_curve.Offset(rg.Plane.WorldXY, -distance, 0.01, rg.CurveOffsetCornerStyle.Sharp)
    
    if offset_curves is None or len(offset_curves) == 0:
        return None  # Return None if the offset fails or does not generate any curves

    # Convert offset curves to polylines
    polylines = []
    for curve in offset_curves:
        polyline_curve = rg.PolylineCurve.ToPolyline(curve)  # Convert to polyline
        polylines.append(polyline_curve)
    
    return polylines

# Example usage in Grasshopper:
# Points and distance are input parameters in Grasshopper
offset_polylines = parallel_lines_from_points(points, distance)

# Output the offset polylines to Grasshopper
a = offset_polylines  # 'a' is the output of the Grasshopper Python component
# ---------- end ipy2_6 ----------
panel_2 = Panel(ipy2_4.a)
pt_4 = Point(ipy2_4.a)
ipy2_7 = IronPython2Script(points=ipy2.a, long_spacing=Slider(9, range=5..30), short_spacing=Slider(31, range=0..100))  # -> out, a; inputs points: list of Point3d, long_spacing: Int32, short_spacing: Int32
# ---------- ipy2_7: IronPython ----------
import rhinoscriptsyntax as rs
import math

def sort_points_counterclockwise(points):
    """
    Sort points in counterclockwise order around their centroid.
    
    Parameters:
        points (list): A list of 3D points to be sorted.
    
    Returns:
        list: A sorted list of points in counterclockwise order.
    """
    # Calculate the centroid (average of the points)
    centroid_x = sum(p.X for p in points) / len(points)
    centroid_y = sum(p.Y for p in points) / len(points)
    centroid = rs.CreatePoint(centroid_x, centroid_y, 0)
    
    # Function to calculate the angle between a point and the centroid
    def angle_from_centroid(point):
        return math.atan2(point.Y - centroid.Y, point.X - centroid.X)

    # Sort points by angle (counterclockwise)
    sorted_points = sorted(points, key=angle_from_centroid)
    
    return sorted_points

def create_grid_of_points(points, short_spacing, long_spacing):
    """
    Create a grid of points based on the bounding box of the sorted input points, with the specified spacing.
    Points that fall outside the closed polygon formed by the sorted points will be excluded.
    """
    # Sort the input points in counterclockwise order
    sorted_points = sort_points_counterclockwise(points)

    # Create a closed polyline from the sorted points to define the shape
    polygon_curve = rs.AddPolyline(sorted_points + [sorted_points[0]])  # Close the shape by adding the first point at the end

    # Calculate the bounding box of the sorted points
    bounding_box = rs.BoundingBox(sorted_points)

    # Extract the corners of the bounding box
    pt0 = bounding_box[0]  # Bottom-left corner
    pt1 = bounding_box[1]  # Bottom-right corner
    pt2 = bounding_box[3]  # Top-left corner
    pt3 = bounding_box[2]  # Top-right corner

    # Calculate lengths of the sides of the bounding box
    horizontal_length = rs.Distance(pt0, pt1)  # Length of the bottom (horizontal) side
    vertical_length = rs.Distance(pt1, pt3)    # Length of the right (vertical) side

    # Swap the usage of long_spacing and short_spacing
    if horizontal_length > vertical_length:
        long_length = horizontal_length
        short_length = vertical_length
        num_long_points = int(long_length // short_spacing)  # Apply short_spacing to the longest side (horizontal)
        num_short_points = int(short_length // long_spacing)  # Apply long_spacing to the shortest side (vertical)
    else:
        long_length = vertical_length
        short_length = horizontal_length
        num_long_points = int(long_length // short_spacing)  # Apply short_spacing to the longest side (vertical)
        num_short_points = int(short_length // long_spacing)  # Apply long_spacing to the shortest side (horizontal)

    grid_points = []

    # Generate points on the grid based on the bounding box
    for i in range(num_short_points + 1):
        short_side_point = pt0 + (pt1 - pt0) * (i / float(num_short_points))  # Points along the short side
        for j in range(num_long_points + 1):
            long_side_point = pt0 + (pt2 - pt0) * (j / float(num_long_points))  # Points along the long side
            new_point = short_side_point + (long_side_point - pt0)
            
            # Check if the point is inside the polygon using rs.PointInPlanarClosedCurve()
            if rs.PointInPlanarClosedCurve(new_point, polygon_curve) == 1:
                grid_points.append(new_point)

    # Clean up: delete the temporary polygon curve
    rs.DeleteObject(polygon_curve)

    return grid_points

# Example input points
input_points = [rs.coerce3dpoint(x) for x in points]  # Input list of points (assumed to be 3D points)

# Create the grid
result_grid = create_grid_of_points(input_points, short_spacing, long_spacing)

# Output the resulting grid points
a = result_grid
# ---------- end ipy2_7 ----------
